# Grasshopper definition KinergyMainInterface.gh (Grasshopper 1.0.7)
# plug-ins: Human UI, InstantExtension, KinergyUtilities, MSThrowing

# ---- group: Playground for testing
c_script = CSharpScript()  # -> out, A
# ---------- c_script: C# ----------
    string str1 = System.AppDomain.CurrentDomain.BaseDirectory;
    A = str1;
# ---------- end c_script ----------
panel = Panel(c_script.A)

# ----
python = GhPythonScript()  # -> out, a
# ---------- python: Python ----------
__author__ = "lianghe"
__version__ = "2020.04.19"

import rhinoscriptsyntax as rs

import os

pre_path = os.path.abspath('.')[:os.path.abspath('.').rfind('\\')]
a=pre_path+"\Plug-ins\Grasshopper\Components\Resources\images\ReciprocalMovingIcon.png"
# ---------- end python ----------
python_2 = GhPythonScript()  # -> out, a
# ---------- python_2: Python ----------
__author__ = "lianghe"
__version__ = "2020.04.19"

import rhinoscriptsyntax as rs

import os

pre_path = os.path.abspath('.')[:os.path.abspath('.').rfind('\\')]
a=pre_path+"\Plug-ins\Grasshopper\Components\Resources\images\ContinuousSpinningIcon.png"
# ---------- end python_2 ----------
python_3 = GhPythonScript()  # -> out, a
# ---------- python_3: Python ----------
__author__ = "lianghe"
__version__ = "2020.04.19"

import rhinoscriptsyntax as rs

import os

pre_path = os.path.abspath('.')[:os.path.abspath('.').rfind('\\')]
a=pre_path+"\Plug-ins\Grasshopper\Components\Resources\images\ContinuousLinearMovingIcon.png"
# ---------- end python_3 ----------
python_4 = GhPythonScript()  # -> out, a
# ---------- python_4: Python ----------
__author__ = "lianghe"
__version__ = "2020.04.19"

import rhinoscriptsyntax as rs

import os

pre_path = os.path.abspath('.')[:os.path.abspath('.').rfind('\\')]
a=pre_path+"\Plug-ins\Grasshopper\Components\Resources\images\InstantExtensionIcon.png"
# ---------- end python_4 ----------
python_5 = GhPythonScript()  # -> out, a
# ---------- python_5: Python ----------
__author__ = "lianghe"
__version__ = "2020.04.19"

import rhinoscriptsyntax as rs

import os

pre_path = os.path.abspath('.')[:os.path.abspath('.').rfind('\\')]
a=pre_path+"\Plug-ins\Grasshopper\Components\Resources\images\InstantSpinningIcon.png"
# ---------- end python_5 ----------
width = Slider(330, range=0..1000)
height = Slider(56, range=0..1000)
number_slider = Slider(0, range=0..100)

# ---- group: Intermittent Motion Group
python_6 = GhPythonScript()  # -> out, a
# ---------- python_6: Python ----------
__author__ = "lianghe"
__version__ = "2020.04.19"

import rhinoscriptsyntax as rs

import os

pre_path = os.path.abspath('.')[:os.path.abspath('.').rfind('\\')]
a=pre_path+"\Plug-ins\Grasshopper\Components\Resources\images\IntermittentHoppingIcon.png"
# ---------- end python_6 ----------
button = CreateButton(ImagePath=python_6.a, ButtonStyle=0)
adjustpos = AdjustElementPositioning(
    ElementsToAdjust=button,
    Margin="10,10,0,10",
    AbsolutePositioning=False,
    Width=width,
    Height=height,
    HorizontalAlignment=number_slider)
expander = CreateExpander(UIElements=button, Header="Intermittent Motion", Open=True)

# ----
values = ValueListener(Elements=button, SomeProperty=True)  # -> Values, Indices

# ---- group: Instant Motion Group
python_7 = GhPythonScript()  # -> out, a
# ---------- python_7: Python ----------
__author__ = "lianghe"
__version__ = "2020.04.19"

import rhinoscriptsyntax as rs

import os

pre_path = os.path.abspath('.')[:os.path.abspath('.').rfind('\\')]
a=pre_path+"\Plug-ins\Grasshopper\Components\Resources\images\InstantThrowingIcon.png"
# ---------- end python_7 ----------
button_2 = CreateButton(ImagePath=python_5.a, ButtonStyle=0)
button_3 = CreateButton(ImagePath=python_4.a, ButtonStyle=0)
button_4 = CreateButton(ImagePath=python_7.a, ButtonStyle=0)
adjustpos_2 = AdjustElementPositioning(
    ElementsToAdjust=button_4,
    Margin="10,10,0,10",
    AbsolutePositioning=False,
    Width=width,
    Height=height,
    HorizontalAlignment=number_slider)
merge = Merge(Data1=button_3, Data2=button_2, Data3=button_4)
values_2 = ValueListener(Elements=button_4, SomeProperty=True)  # -> Values, Indices
expander_2 = CreateExpander(UIElements=merge, Header="Instant Motion", Open=True)
values_3 = ValueListener(Elements=button_3, SomeProperty=True)  # -> Values, Indices
values_4 = ValueListener(Elements=button_2, SomeProperty=True)  # -> Values, Indices

# ---- group: Continuous Motion Group
button_5 = CreateButton(ImagePath=python_3.a, ButtonStyle=0)
button_6 = CreateButton(ImagePath=python_2.a, ButtonStyle=0)
button_7 = CreateButton(ImagePath=python.a, ButtonStyle=0)
adjustpos_3 = AdjustElementPositioning(
    ElementsToAdjust=button_7,
    Margin="10,10,0,10",
    AbsolutePositioning=False,
    Width=width,
    Height=height,
    HorizontalAlignment=number_slider)
adjustpos_4 = AdjustElementPositioning(ElementsToAdjust=[button_2, button_6], Margin="0,10,0,10", AbsolutePositioning=False, Width=width, Height=height)
merge_2 = Merge(Data1=button_5, Data2=button_6, Data3=button_7)
expander_3 = CreateExpander(UIElements=merge_2, Header="Continuous Motion", Open=True)
values_5 = ValueListener(Elements=button_5, SomeProperty=True)  # -> Values, Indices
values_6 = ValueListener(Elements=button_6, SomeProperty=True)  # -> Values, Indices
values_7 = ValueListener(Elements=button_7, SomeProperty=True)  # -> Values, Indices

# ---- group: Instant Motion Group (continued)
adjustpos_5 = AdjustElementPositioning(
    ElementsToAdjust=[button_3, button_5],
    Margin="10,10,0,10",
    AbsolutePositioning=False,
    Width=width,
    Height=height,
    HorizontalAlignment=number_slider)

# ---- group: MAIN WINDOW
merge_3 = Merge(Data1=expander_2, Data2=expander, Data3=expander_3)
launchwin = LaunchWindow(
    Show=Toggle(True),
    Name="Kinergy",
    Width=Slider(380, range=0..1000),
    Height=Slider(710, range=0..1000),
    ChildStatus=0,
    EnableHorizScroll=False)
addelems = AddElements(Window=launchwin, Elements=flatten(merge_3), DoVLChecking=True)  # -> AddedElements, ElementNames

# ----
selectchildwindow = GhPythonScript(
    c0=values_3.Values,
    c1=values_4.Values,
    c2=values_2.Values,
    c3=values.Values,
    c4=values_5.Values,
    c5=values_6.Values,
    c6=values_7.Values)  # -> c0_2, c1_2, c2_2, c3_2, c4_2, c5_2, c6_2; inputs c0: Boolean, c1: Boolean, c2: Boolean, c3: Boolean, c4: Boolean, c5: Boolean, c6: Boolean
# ---------- selectchildwindow: Python ----------
__author__ = "liang he"
__version__ = "2020.04.20"

import rhinoscriptsyntax as rs
def compareValue(a,b):
    if(a==b):
        return False;
    return True;

#Make persistent value to keep track of last value
if "lastValue" not in globals():
    lastValue=[c0,c1,c2,c3,c4,c5,c6];

#Check that current value is different from last value
newValue=[c0,c1,c2,c3,c4,c5,c6];
for i,val in enumerate(newValue):
    if val==True:
        lastValue=[False,False,False,False,False,False,False];
        lastValue[i]=True;
        break;
        
c0_2=lastValue[0];
c1_2=lastValue[1];
c2_2=lastValue[2];
c3_2=lastValue[3];
c4_2=lastValue[4];
c5_2=lastValue[5];
c6_2=lastValue[6];
# ---------- end selectchildwindow ----------

# ---- group: TOADD: CHILDWINDOW
it_height = Slider(390, range=0..1000)
ie_height = Slider(370, range=0..1000)
cs_height = Slider(390, range=0..1000)
rm_height = Slider(370, range=0..1000)
is_height = Slider(370, range=0..1000)
ih_height = Slider(380, range=0..1000)
cm_height = Slider(400, range=0..1000)
it_width = Slider(310, range=0..1000)
cs_width = Slider(310, range=0..1000)
rm_width = Slider(310, range=0..1000)
ie_width = Slider(310, range=0..1000)
ih_width = Slider(310, range=0..1000)
is_width = Slider(310, range=0..1000)
cm_width = Slider(310, range=0..1000)
launchwin_2 = LaunchWindow(
    Show=selectchildwindow.c6_2,
    Name="Reciprocal Moving",
    Width=rm_width,
    Height=rm_height,
    ChildStatus=0,
    EnableHorizScroll=False)
launchwin_3 = LaunchWindow(
    Show=selectchildwindow.c0_2,
    Name="Instant Extension Motion",
    Width=ie_width,
    Height=ie_height,
    ChildStatus=0,
    EnableHorizScroll=False)
launchwin_4 = LaunchWindow(
    Show=selectchildwindow.c1_2,
    Name="Instant Spinning Motion",
    Width=is_width,
    Height=is_height,
    ChildStatus=0,
    EnableHorizScroll=False)
launchwin_5 = LaunchWindow(
    Show=selectchildwindow.c5_2,
    Name="Continuous Spinning Motion",
    Width=cs_width,
    Height=cs_height,
    ChildStatus=0,
    EnableHorizScroll=False)
launchwin_6 = LaunchWindow(
    Show=selectchildwindow.c2_2,
    Name="Instant Throwing",
    Width=it_width,
    Height=it_height,
    ChildStatus=0,
    EnableHorizScroll=False)
launchwin_7 = LaunchWindow(
    Show=selectchildwindow.c4_2,
    Name="Continuous Linear Moving Motion",
    Width=cm_width,
    Height=cm_height,
    ChildStatus=0,
    EnableHorizScroll=False)
launchwin_8 = LaunchWindow(
    Show=selectchildwindow.c3_2,
    Name="Intermittent Hopping Motion",
    Width=ih_width,
    Height=ih_height,
    ChildStatus=0,
    EnableHorizScroll=False)
childwin = MakeChildWindow(ParentWindow=launchwin, ChildWindow=launchwin_3)
childwin_2 = MakeChildWindow(ParentWindow=launchwin, ChildWindow=launchwin_4)
childwin_3 = MakeChildWindow(ParentWindow=launchwin, ChildWindow=launchwin_6)
childwin_4 = MakeChildWindow(ParentWindow=launchwin, ChildWindow=launchwin_8)
childwin_5 = MakeChildWindow(ParentWindow=launchwin, ChildWindow=launchwin_7)
childwin_6 = MakeChildWindow(ParentWindow=launchwin, ChildWindow=launchwin_5)
childwin_7 = MakeChildWindow(ParentWindow=launchwin, ChildWindow=launchwin_2)

# ---- group: Instant Extension Window Style
compression = Slider(0.5, range=0..1)
strength = Slider(0.5, range=0..1)
height_2 = Slider(30, range=0..500)
slider = CreateSlider(Slider=compression, ShowBounds=False, ShowTicks=False, ShowTooltip=False, ShowValLabel=True, showLabel=True)
border_corner_radius = Slider(0, range=0..10)
adjustpos_6 = AdjustElementPositioning(ElementsToAdjust=slider, Margin="0,-10,0,0", AbsolutePositioning=False, Height=height_2)
thumbnail_width = Slider(100, range=0..1000)
title_size = Slider(11, range=0..20)
title_size_2 = Slider(16, range=0..20)
border_thickness = Slider(1, range=0..10)
panel_2 = Panel("This unit has three parts: a helical spring, a rod, and a locking mechanism. The spring can be compressed and locked and extends immediately once the lock is released.")
height_3 = Slider(30, range=0..500)
true_button = CreateTrueOnlyButton(ButtonName="Set Motion Direction", ButtonStyle=0)
python_8 = GhPythonScript()  # -> out, a
# ---------- python_8: Python ----------
__author__ = "lianghe"
__version__ = "2020.04.19"

import rhinoscriptsyntax as rs

import os

pre_path = os.path.abspath('.')[:os.path.abspath('.').rfind('\\')]
a=pre_path+"\Plug-ins\Grasshopper\Components\Resources\images\IE.png"
# ---------- end python_8 ----------
slider_2 = CreateSlider(Slider=strength, ShowBounds=False, ShowTicks=False, ShowTooltip=False, ShowValLabel=True, showLabel=True)
adjustpos_7 = AdjustElementPositioning(ElementsToAdjust=slider_2, Margin="25,0,0,0", AbsolutePositioning=False, Height=height_3)
height_4 = Slider(30, range=0..500)
width_2 = Slider(123, range=0..500)
height_5 = Slider(30, range=0..500)
width_3 = Slider(150, range=0..500)
image = CreateImage(ImageSource=python_8.a, ImageWidth=thumbnail_width, ImageHeight=thumbnail_width)
checkbox = CreateCheckbox(Label="Energy Control Lock", StartingValue=Toggle(False))
label = CreateLabel(LabelText="Instant Extension", LabelSize=title_size_2, Justification=0)
tb = CreateTextBlock(Text=panel_2, TextSize=title_size, Justification=0)
merge_4 = Merge(Data1=true_button, Data2=checkbox, Data3=slider, Data4=slider_2)
button_8 = CreateButton(ButtonName="Preview Motion", ButtonStyle=0)
expander_4 = CreateExpander(UIElements=merge_4, Header="Motion Control & Design", Open=True)
height_6 = Slider(30, range=0..500)
adjustpos_8 = AdjustElementPositioning(ElementsToAdjust=label, Margin="110,-120,0,10", AbsolutePositioning=False)
adjustpos_9 = AdjustElementPositioning(ElementsToAdjust=tb, Margin="110,-90,10,10", AbsolutePositioning=False, Width=width_3)
adjustpos_10 = AdjustElementPositioning(ElementsToAdjust=checkbox, Margin="140,-50,0,10", AbsolutePositioning=False)
adjustpos_11 = AdjustElementPositioning(ElementsToAdjust=image, Margin="10,10,10,10", AbsolutePositioning=False)
adjustpos_12 = AdjustElementPositioning(ElementsToAdjust=true_button, Margin="-150,0,0,10", AbsolutePositioning=False, Width=width_2, Height=height_4)
true_button_2 = CreateTrueOnlyButton(ButtonName="Add Kinetic Unit", ButtonStyle=0)
adjustpos_13 = AdjustElementPositioning(ElementsToAdjust=button_8, Margin="180,-40,0,10", AbsolutePositioning=False, Height=height_5)
merge_5 = Merge(Data1=image, Data2=label, Data3=tb, Data4=expander_4, Data6=true_button_2, Data7=button_8)
adjustpos_14 = AdjustElementPositioning(ElementsToAdjust=true_button_2, Margin="-180,10,0,10", AbsolutePositioning=False, Height=height_6)
addelems_2 = AddElements(Window=launchwin_3, Elements=flatten(merge_5), DoVLChecking=True)  # -> AddedElements, ElementNames

# ---- group: Instant Extension Events
values_8 = ValueListener(Elements=slider, SomeProperty=True)  # -> Values, Indices
values_9 = ValueListener(Elements=slider_2, SomeProperty=True)  # -> Values, Indices
values_10 = ValueListener(Elements=true_button_2, SomeProperty=True)  # -> Values, Indices
values_11 = ValueListener(Elements=true_button, SomeProperty=True)  # -> Values, Indices
setdir = SetDirection(Select=values_11.Values)  # -> DirVector, ArrowCrv, SelectedBrep
ie = InstantExtension(
    Start=values_10.Values,
    Model=setdir.SelectedBrep,
    SpringDirection=setdir.DirVector,
    Energy=values_9.Values,
    Distance=values_8.Values)
preprocessie = _01ModelPreprocessOfIE(Motion=ie)  # -> Motion, SpringPositionCandidates
sp = SelectPosition(PositionCandidates=preprocessie.SpringPositionCandidates, Select=Toggle(True))
constructspring = _02ConstructSpringOfIE(Motion=preprocessie.Motion, SpringPosition=sp)  # -> Motion, LockDirectionCandidates, Spring
sd = SelectDirection(DirectionCandidates=constructspring.LockDirectionCandidates, Select=Toggle(True))
nickname = _03GenerateLockPositionCandidateOfIE(Motion=constructspring.Motion, LockDirection=sd)  # -> Motion, LockPositionCandidates
sp_2 = SelectPosition(PositionCandidates=nickname.LockPositionCandidates, Select=Toggle(True))
constructlock = _04ConstructLockOfIE(Motion=nickname.Motion, LockPosition=sp_2)  # -> Motion, Models

# ---- group: Instant Spinning Window Style
height_7 = Slider(30, range=0..30)
checkbox_2 = CreateCheckbox(Label="Energy Control Lock", StartingValue=False)
button_9 = CreateButton(ButtonName="Preview Motion", ButtonStyle=0)
adjustpos_15 = AdjustElementPositioning(ElementsToAdjust=button_9, Margin="180,-22,0,10", AbsolutePositioning=False, Height=height_7)
adjustpos_16 = AdjustElementPositioning(ElementsToAdjust=checkbox_2, Margin="0,15,0,0", AbsolutePositioning=False)
thumbnail_width_2 = Slider(100, range=0..1000)
title_size_3 = Slider(16, range=0..20)
title_size_4 = Slider(11, range=0..20)
panel_3 = Panel("This unit has a spiral spring and a locking mechanism. The energy can be stored by twising this unit. Once the twisted spring is released, the body will spin immediately.")
width_4 = Slider(162, range=0..200)
python_9 = GhPythonScript()  # -> out, a
# ---------- python_9: Python ----------
__author__ = "lianghe"
__version__ = "2020.04.19"

import rhinoscriptsyntax as rs

import os

pre_path = os.path.abspath('.')[:os.path.abspath('.').rfind('\\')]
a=pre_path+"\Plug-ins\Grasshopper\Components\Resources\images\IS.png"
# ---------- end python_9 ----------
height_8 = Slider(30, range=0..30)
width_5 = Slider(175, range=0..300)
button_10 = CreateButton(ButtonName="Select & Set Motion Direction", ButtonStyle=0)
image_2 = CreateImage(ImageSource=python_9.a, ImageWidth=thumbnail_width_2, ImageHeight=thumbnail_width_2)
tb_2 = CreateTextBlock(Text=panel_3, TextSize=title_size_4, Justification=0)
label_2 = CreateLabel(LabelText="Instant Spinning", LabelSize=title_size_3, Justification=0)
adjustpos_17 = AdjustElementPositioning(ElementsToAdjust=button_10, Margin="100,0,0,10", AbsolutePositioning=False, Width=width_4, Height=height_8)
adjustpos_18 = AdjustElementPositioning(ElementsToAdjust=tb_2, Margin="115,-90,0,10", AbsolutePositioning=False, Width=width_5)
adjustpos_19 = AdjustElementPositioning(ElementsToAdjust=label_2, Margin="110,-120,0,10", AbsolutePositioning=False)
adjustpos_20 = AdjustElementPositioning(ElementsToAdjust=image_2, Margin="0,0,10,10", AbsolutePositioning=False)
max_angle = Slider(60, range=60..180)
height_9 = Slider(30, range=0..30)
strength_2 = Slider(0.5, range=0..1)
height_10 = Slider(30, range=0..30)
slider_3 = CreateSlider(Slider=max_angle, ShowBounds=False, ShowTicks=False, ShowTooltip=False, ShowValLabel=True, showLabel=True)
slider_4 = CreateSlider(Slider=strength_2, ShowBounds=False, ShowTicks=False, ShowTooltip=False, ShowValLabel=True, showLabel=True)
adjustpos_21 = AdjustElementPositioning(ElementsToAdjust=slider_3, AbsolutePositioning=False, Height=height_9)
adjustpos_22 = AdjustElementPositioning(ElementsToAdjust=slider_4, AbsolutePositioning=False, Height=height_10)
merge_6 = Merge(Data1=slider_3, Data2=slider_4)
expander_5 = CreateExpander(UIElements=merge_6, Header="Motion Control & Design", Open=True)
merge_7 = Merge(Data1=image_2, Data2=label_2, Data3=tb_2, Data4=button_10, Data5=expander_5, Data6=checkbox_2, Data7=button_9)
addelems_3 = AddElements(Window=launchwin_4, Elements=flatten(merge_7), DoVLChecking=True)  # -> AddedElements, ElementNames

# ---- group: Intermittent Hopping Window Style
height_11 = Slider(30, range=0..30)
checkbox_3 = CreateCheckbox(Label="Energy Control Lock", StartingValue=False)
button_11 = CreateButton(ButtonName="Preview Motion", ButtonStyle=0)
adjustpos_23 = AdjustElementPositioning(ElementsToAdjust=button_11, Margin="180,-22,0,10", AbsolutePositioning=False, Height=height_11)
adjustpos_24 = AdjustElementPositioning(ElementsToAdjust=checkbox_3, Margin="0,15,0,0", AbsolutePositioning=False)
thumbnail_width_3 = Slider(100, range=0..1000)
title_size_5 = Slider(16, range=0..20)
title_size_6 = Slider(11, range=0..20)
panel_4 = Panel("This unit is composed of a helical spring, a gearbox, a geneva drive, and a spiral spring. Once the spiral spring is unlocked, the body will perform an intermittent hopping motion.")
python_10 = GhPythonScript()  # -> out, a
# ---------- python_10: Python ----------
__author__ = "lianghe"
__version__ = "2020.04.19"

import rhinoscriptsyntax as rs

import os

pre_path = os.path.abspath('.')[:os.path.abspath('.').rfind('\\')]
a=pre_path+"\Plug-ins\Grasshopper\Components\Resources\images\IH.png"
# ---------- end python_10 ----------
width_6 = Slider(162, range=0..200)
height_12 = Slider(30, range=0..30)
width_7 = Slider(175, range=0..300)
button_12 = CreateButton(ButtonName="Select & Set Motion Direction", ButtonStyle=0)
image_3 = CreateImage(ImageSource=python_10.a, ImageWidth=thumbnail_width_3, ImageHeight=thumbnail_width_3)
tb_3 = CreateTextBlock(Text=panel_4, TextSize=title_size_6, Justification=0)
label_3 = CreateLabel(LabelText="Intermittent Hopping", LabelSize=title_size_5, Justification=0)
adjustpos_25 = AdjustElementPositioning(ElementsToAdjust=tb_3, Margin="115,-100,0,10", AbsolutePositioning=False, Width=width_7)
adjustpos_26 = AdjustElementPositioning(ElementsToAdjust=button_12, Margin="100,0,0,10", AbsolutePositioning=False, Width=width_6, Height=height_12)
adjustpos_27 = AdjustElementPositioning(ElementsToAdjust=label_3, Margin="110,-130,0,10", AbsolutePositioning=False)
adjustpos_28 = AdjustElementPositioning(ElementsToAdjust=image_3, Margin="0,10,10,10", AbsolutePositioning=False)
frequency = Slider(60, range=10..90)
height_13 = Slider(30, range=0..30)
amplitude = Slider(0.5, range=0..1)
height_14 = Slider(30, range=0..30)
slider_5 = CreateSlider(Slider=frequency, ShowBounds=False, ShowTicks=False, ShowTooltip=False, ShowValLabel=True, showLabel=True)
slider_6 = CreateSlider(Slider=amplitude, ShowBounds=False, ShowTicks=False, ShowTooltip=False, ShowValLabel=True, showLabel=True)
adjustpos_29 = AdjustElementPositioning(ElementsToAdjust=slider_5, AbsolutePositioning=False, Height=height_13)
adjustpos_30 = AdjustElementPositioning(ElementsToAdjust=slider_6, AbsolutePositioning=False, Height=height_14)
merge_8 = Merge(Data1=slider_5, Data2=slider_6)
expander_6 = CreateExpander(UIElements=merge_8, Header="Motion Control & Design", Open=True)
merge_9 = Merge(Data1=image_3, Data2=label_3, Data3=tb_3, Data4=button_12, Data5=expander_6, Data6=checkbox_3, Data7=button_11)
addelems_4 = AddElements(Window=launchwin_8, Elements=flatten(merge_9), DoVLChecking=True)  # -> AddedElements, ElementNames

# ---- group: Continuous Moving Window Style
title_size_7 = Slider(13, range=0..20)
thumbnail_width_4 = Slider(100, range=0..1000)
title_size_8 = Slider(11, range=0..20)
title_size_9 = Slider(16, range=0..20)
panel_5 = Panel("This unit has a helical spring, a rack and pinion, and a gearbox. When the helial spring is pressed, the object attached to the rear axis in the gearbox will rotate, activating the whole body to move forward.")
python_11 = GhPythonScript()  # -> out, a
# ---------- python_11: Python ----------
__author__ = "lianghe"
__version__ = "2020.04.19"

import rhinoscriptsyntax as rs

import os

pre_path = os.path.abspath('.')[:os.path.abspath('.').rfind('\\')]
a=pre_path+"\Plug-ins\Grasshopper\Components\Resources\images\CLMP.png"
# ---------- end python_11 ----------
label_4 = CreateLabel(LabelText="(by pressing)", LabelSize=title_size_7, Justification=0)
width_8 = Slider(175, range=0..300)
width_9 = Slider(165, range=0..200)
image_4 = CreateImage(ImageSource=python_11.a, ImageWidth=thumbnail_width_4, ImageHeight=thumbnail_width_4)
height_15 = Slider(30, range=0..30)
label_5 = CreateLabel(LabelText="Continues Moving", LabelSize=title_size_9, Justification=0)
tb_4 = CreateTextBlock(Text=panel_5, TextSize=title_size_8, Justification=0)
adjustpos_31 = AdjustElementPositioning(ElementsToAdjust=label_4, Margin="110,-110,0,10", AbsolutePositioning=False)
button_13 = CreateButton(ButtonName="Set Motion Direction", ButtonStyle=0)
radiobtn = CreateRadioButton(RadioButtonName="By Pressing", RadioButtonGroup="Ratio Group 1", InitiallySelected=Toggle(True))
adjustpos_32 = AdjustElementPositioning(ElementsToAdjust=label_5, Margin="110,-130,0,10", AbsolutePositioning=False)
adjustpos_33 = AdjustElementPositioning(ElementsToAdjust=image_4, Margin="0,10,10,10", AbsolutePositioning=False)
adjustpos_34 = AdjustElementPositioning(ElementsToAdjust=tb_4, Margin="115,-85,0,10", AbsolutePositioning=False, Width=width_8)
adjustpos_35 = AdjustElementPositioning(ElementsToAdjust=button_13, Margin="100,-50,0,10", AbsolutePositioning=False, Width=width_9, Height=height_15)
adjustpos_36 = AdjustElementPositioning(ElementsToAdjust=radiobtn, Margin="0,-25,0,0", AbsolutePositioning=False)
radiobtn_2 = CreateRadioButton(RadioButtonName="By Rotating", RadioButtonGroup="Ratio Group 1", InitiallySelected=Toggle(False))
adjustpos_37 = AdjustElementPositioning(ElementsToAdjust=radiobtn_2, Margin="0,-25,0,0", AbsolutePositioning=False)
height_16 = Slider(30, range=0..30)
distance = Slider(60, range=10..90)
height_17 = Slider(30, range=0..30)
speed = Slider(0.5, range=0..1)
height_18 = Slider(30, range=0..30)
checkbox_4 = CreateCheckbox(Label="Energy Control Lock", StartingValue=False)
button_14 = CreateButton(ButtonName="Preview Motion", ButtonStyle=0)
slider_7 = CreateSlider(Slider=distance, ShowBounds=False, ShowTicks=False, ShowTooltip=False, ShowValLabel=True, showLabel=True)
slider_8 = CreateSlider(Slider=speed, ShowBounds=False, ShowTicks=False, ShowTooltip=False, ShowValLabel=True, showLabel=True)
adjustpos_38 = AdjustElementPositioning(ElementsToAdjust=button_14, Margin="180,-22,0,10", AbsolutePositioning=False, Height=height_16)
adjustpos_39 = AdjustElementPositioning(ElementsToAdjust=checkbox_4, Margin="0,15,0,0", AbsolutePositioning=False)
adjustpos_40 = AdjustElementPositioning(ElementsToAdjust=slider_7, AbsolutePositioning=False, Height=height_17)
adjustpos_41 = AdjustElementPositioning(ElementsToAdjust=slider_8, AbsolutePositioning=False, Height=height_18)
merge_10 = Merge(Data1=slider_7, Data2=slider_8)
expander_7 = CreateExpander(UIElements=merge_10, Header="Motion Control & Design", Open=True)
merge_11 = Merge(
    Data1=image_4,
    Data2=label_5,
    Data3=label_4,
    Data4=tb_4,
    Data5=radiobtn,
    Data6=radiobtn_2,
    Data7=button_13,
    Data8=expander_7,
    Data9=checkbox_4,
    Data10=button_14)
addelems_5 = AddElements(Window=launchwin_7, Elements=flatten(merge_11), DoVLChecking=True)  # -> AddedElements, ElementNames

# ---- group: Continuous Spinning Window Style
title_size_10 = Slider(13, range=0..20)
thumbnail_width_5 = Slider(100, range=0..1000)
title_size_11 = Slider(11, range=0..20)
panel_6 = Panel("This unit has a helical spring, a rack and pinion, and gears. When the helial spring is pressed, the object attached to the rear gear will rotate, activating a spinning motion.")
title_size_12 = Slider(16, range=0..20)
python_12 = GhPythonScript()  # -> out, a
# ---------- python_12: Python ----------
__author__ = "lianghe"
__version__ = "2020.04.19"

import rhinoscriptsyntax as rs

import os

pre_path = os.path.abspath('.')[:os.path.abspath('.').rfind('\\')]
a=pre_path+"\Plug-ins\Grasshopper\Components\Resources\images\CRP.png"
# ---------- end python_12 ----------
width_10 = Slider(165, range=0..200)
label_6 = CreateLabel(LabelText="(by pressing)", LabelSize=title_size_10, Justification=0)
height_19 = Slider(30, range=0..30)
button_15 = CreateButton(ButtonName="Set Motion Direction ", ButtonStyle=0)
width_11 = Slider(175, range=0..300)
image_5 = CreateImage(ImageSource=python_12.a, ImageWidth=thumbnail_width_5, ImageHeight=thumbnail_width_5)
tb_5 = CreateTextBlock(Text=panel_6, TextSize=title_size_11, Justification=0)
label_7 = CreateLabel(LabelText="Continues Spinning", LabelSize=title_size_12, Justification=0)
adjustpos_42 = AdjustElementPositioning(ElementsToAdjust=label_6, Margin="110,-100,0,10", AbsolutePositioning=False)
adjustpos_43 = AdjustElementPositioning(ElementsToAdjust=button_15, Margin="100,-50,0,10", AbsolutePositioning=False, Width=width_10, Height=height_19)
adjustpos_44 = AdjustElementPositioning(ElementsToAdjust=tb_5, Margin="115,-75,0,10", AbsolutePositioning=False, Width=width_11)
adjustpos_45 = AdjustElementPositioning(ElementsToAdjust=label_7, Margin="110,-120,0,10", AbsolutePositioning=False)
adjustpos_46 = AdjustElementPositioning(ElementsToAdjust=image_5, Margin="0,0,10,10", AbsolutePositioning=False)
height_20 = Slider(30, range=0..30)
checkbox_5 = CreateCheckbox(Label="Energy Control Lock", StartingValue=False)
button_16 = CreateButton(ButtonName="Preview Motion", ButtonStyle=0)
adjustpos_47 = AdjustElementPositioning(ElementsToAdjust=button_16, Margin="180,-22,0,10", AbsolutePositioning=False, Height=height_20)
adjustpos_48 = AdjustElementPositioning(ElementsToAdjust=checkbox_5, Margin="0,15,0,0", AbsolutePositioning=False)
radiobtn_3 = CreateRadioButton(RadioButtonName="By Pressing", RadioButtonGroup="Ratio Group 1", InitiallySelected=Toggle(True))
rounds = Slider(60, range=10..90)
height_21 = Slider(30, range=0..30)
speed_2 = Slider(0.5, range=0..1)
height_22 = Slider(30, range=0..30)
slider_9 = CreateSlider(Slider=rounds, ShowBounds=False, ShowTicks=False, ShowTooltip=False, ShowValLabel=True, showLabel=True)
slider_10 = CreateSlider(Slider=speed_2, ShowBounds=False, ShowTicks=False, ShowTooltip=False, ShowValLabel=True, showLabel=True)
adjustpos_49 = AdjustElementPositioning(ElementsToAdjust=radiobtn_3, Margin="0,-20,0,0", AbsolutePositioning=False)
adjustpos_50 = AdjustElementPositioning(ElementsToAdjust=slider_9, AbsolutePositioning=False, Height=height_21)
adjustpos_51 = AdjustElementPositioning(ElementsToAdjust=slider_10, AbsolutePositioning=False, Height=height_22)
merge_12 = Merge(Data1=slider_9, Data2=slider_10)
radiobtn_4 = CreateRadioButton(RadioButtonName="By Rotating", RadioButtonGroup="Ratio Group 1", InitiallySelected=Toggle(False))
expander_8 = CreateExpander(UIElements=merge_12, Header="Motion Control & Design", Open=True)
merge_13 = Merge(
    Data1=image_5,
    Data2=label_7,
    Data3=label_6,
    Data4=tb_5,
    Data5=radiobtn_3,
    Data6=radiobtn_4,
    Data7=button_15,
    Data8=expander_8,
    Data9=checkbox_5,
    Data10=button_16)
addelems_6 = AddElements(Window=launchwin_5, Elements=flatten(merge_13), DoVLChecking=True)  # -> AddedElements, ElementNames
adjustpos_52 = AdjustElementPositioning(ElementsToAdjust=radiobtn_4, Margin="0,-25,0,0", AbsolutePositioning=False)

# ---- group: Reciprocal Moving Window Style
thumbnail_width_6 = Slider(100, range=0..1000)
title_size_13 = Slider(16, range=0..20)
title_size_14 = Slider(11, range=0..20)
panel_7 = Panel("This unit is composed of a spiral spring, a cam, and a movable piston. Once the spiral spring is unlocked, the piston part will perform a reciprocal movement.")
python_13 = GhPythonScript()  # -> out, a
# ---------- python_13: Python ----------
__author__ = "lianghe"
__version__ = "2020.04.19"

import rhinoscriptsyntax as rs

import os

pre_path = os.path.abspath('.')[:os.path.abspath('.').rfind('\\')]
a=pre_path+"\Plug-ins\Grasshopper\Components\Resources\images\RLM.png"
# ---------- end python_13 ----------
height_23 = Slider(30, range=0..30)
width_12 = Slider(80, range=0..200)
height_24 = Slider(30, range=0..30)
width_13 = Slider(80, range=0..200)
height_25 = Slider(30, range=0..30)
width_14 = Slider(115, range=0..200)
width_15 = Slider(175, range=0..300)
button_17 = CreateButton(ButtonName="Select a body", ButtonStyle=0)
button_18 = CreateButton(ButtonName="Select a piston", ButtonStyle=0)
image_6 = CreateImage(ImageSource=python_13.a, ImageWidth=thumbnail_width_6, ImageHeight=thumbnail_width_6)
tb_6 = CreateTextBlock(Text=panel_7, TextSize=title_size_14, Justification=0)
button_19 = CreateButton(ButtonName="Set motion direction", ButtonStyle=0)
label_8 = CreateLabel(LabelText="Reciprocal Moving", LabelSize=title_size_13, Justification=0)
adjustpos_53 = AdjustElementPositioning(ElementsToAdjust=button_17, Margin="-210,0,0,10", AbsolutePositioning=False, Width=width_12, Height=height_23)
adjustpos_54 = AdjustElementPositioning(ElementsToAdjust=tb_6, Margin="115,-90,0,10", AbsolutePositioning=False, Width=width_15)
adjustpos_55 = AdjustElementPositioning(ElementsToAdjust=button_18, Margin="-38,-40,0,10", AbsolutePositioning=False, Width=width_13, Height=height_24)
adjustpos_56 = AdjustElementPositioning(ElementsToAdjust=button_19, Margin="170,-40,0,10", AbsolutePositioning=False, Width=width_14, Height=height_25)
adjustpos_57 = AdjustElementPositioning(ElementsToAdjust=image_6, Margin="0,0,10,10", AbsolutePositioning=False)
adjustpos_58 = AdjustElementPositioning(ElementsToAdjust=label_8, Margin="110,-120,0,10", AbsolutePositioning=False)
height_26 = Slider(30, range=0..30)
cycles = Slider(60, range=10..90)
height_27 = Slider(30, range=0..30)
speed_3 = Slider(0.5, range=0..1)
height_28 = Slider(30, range=0..30)
checkbox_6 = CreateCheckbox(Label="Energy Control Lock", StartingValue=False)
button_20 = CreateButton(ButtonName="Preview Motion", ButtonStyle=0)
slider_11 = CreateSlider(Slider=cycles, ShowBounds=False, ShowTicks=False, ShowTooltip=False, ShowValLabel=True, showLabel=True)
slider_12 = CreateSlider(Slider=speed_3, ShowBounds=False, ShowTicks=False, ShowTooltip=False, ShowValLabel=True, showLabel=True)
adjustpos_59 = AdjustElementPositioning(ElementsToAdjust=button_20, Margin="180,-22,0,10", AbsolutePositioning=False, Height=height_26)
adjustpos_60 = AdjustElementPositioning(ElementsToAdjust=checkbox_6, Margin="0,15,0,0", AbsolutePositioning=False)
adjustpos_61 = AdjustElementPositioning(ElementsToAdjust=slider_11, AbsolutePositioning=False, Height=height_27)
adjustpos_62 = AdjustElementPositioning(ElementsToAdjust=slider_12, AbsolutePositioning=False, Height=height_28)
merge_14 = Merge(Data1=slider_11, Data2=slider_12)
expander_9 = CreateExpander(UIElements=merge_14, Header="Motion Control & Design", Open=True)
merge_15 = Merge(
    Data1=image_6,
    Data2=label_8,
    Data3=tb_6,
    Data4=button_17,
    Data5=button_18,
    Data6=button_19,
    Data7=expander_9,
    Data8=checkbox_6,
    Data9=button_20)
addelems_7 = AddElements(Window=launchwin_2, Elements=flatten(merge_15), DoVLChecking=True)  # -> AddedElements, ElementNames

# ---- group: Instant Throwing Window Style
thumbnail_width_7 = Slider(100, range=0..1000)
panel_8 = Panel("Select a base")
panel_9 = Panel("Set motion direction")
title_size_15 = Slider(16, range=0..20)
title_size_16 = Slider(11, range=0..20)
panel_10 = Panel("With this unit, the body can be bended and locked at different angles. Once the lock is released, the bended body will immediately recover its initial position, resulting in a throwing motion.")
panel_11 = Panel("Select an arm")
python_14 = GhPythonScript()  # -> out, a
# ---------- python_14: Python ----------
__author__ = "lianghe"
__version__ = "2020.04.19"

import rhinoscriptsyntax as rs

import os

pre_path = os.path.abspath('.')[:os.path.abspath('.').rfind('\\')]
a=pre_path+"\Plug-ins\Grasshopper\Components\Resources\images\IT.png"
# ---------- end python_14 ----------
height_29 = Slider(30, range=0..30)
width_16 = Slider(80, range=0..200)
height_30 = Slider(30, range=0..30)
width_17 = Slider(175, range=0..300)
width_18 = Slider(80, range=0..200)
height_31 = Slider(30, range=0..30)
width_19 = Slider(115, range=0..200)
image_7 = CreateImage(ImageSource=python_14.a, ImageWidth=thumbnail_width_7, ImageHeight=thumbnail_width_7)
tb_7 = CreateTextBlock(Text=panel_10, TextSize=title_size_16, Justification=0)
label_9 = CreateLabel(LabelText="Instant Throwing", LabelSize=title_size_15, Justification=0)
adjustpos_63 = AdjustElementPositioning(ElementsToAdjust=tb_7, Margin="115,-100,0,10", AbsolutePositioning=False, Width=width_17)
adjustpos_64 = AdjustElementPositioning(ElementsToAdjust=label_9, Margin="110,-130,0,10", AbsolutePositioning=False)
adjustpos_65 = AdjustElementPositioning(ElementsToAdjust=image_7, Margin="0,20,10,10", AbsolutePositioning=False)
max_angle_2 = Slider(60, range=60..180)
strength_3 = Slider(0.5, range=0..1)
height_32 = Slider(30, range=0..30)
height_33 = Slider(30, range=0..30)
height_34 = Slider(30, range=0..30)
checkbox_7 = CreateCheckbox(Label="Energy Control Lock", StartingValue=False)
slider_13 = CreateSlider(Slider=strength_3, ShowBounds=False, ShowTicks=False, ShowTooltip=False, ShowValLabel=True, showLabel=True)
slider_14 = CreateSlider(Slider=max_angle_2, ShowBounds=False, ShowTicks=False, ShowTooltip=False, ShowValLabel=True, showLabel=True)
button_21 = CreateButton(ButtonName="Preview Motion", ButtonStyle=0)
adjustpos_66 = AdjustElementPositioning(ElementsToAdjust=slider_14, AbsolutePositioning=False, Height=height_33)
adjustpos_67 = AdjustElementPositioning(ElementsToAdjust=slider_13, AbsolutePositioning=False, Height=height_34)
adjustpos_68 = AdjustElementPositioning(ElementsToAdjust=button_21, Margin="180,-22,0,10", AbsolutePositioning=False, Height=height_32)
adjustpos_69 = AdjustElementPositioning(ElementsToAdjust=checkbox_7, Margin="0,15,0,0", AbsolutePositioning=False)
merge_16 = Merge(Data1=slider_14, Data2=slider_13)
expander_10 = CreateExpander(UIElements=merge_16, Header="Motion Control & Design", Open=True)

# ----
pickbtn = CreateRhinoPickButton(ButtonName=panel_11, Prompt="Please select geometry...", AllowMultiple=True, AllowNone=True, Type=0, ButtonStyle=0)
pickbtn_2 = CreateRhinoPickButton(ButtonName=panel_8, Prompt="Please select geometry...", AllowMultiple=True, AllowNone=True, Type=0, ButtonStyle=0)
true_button_3 = CreateTrueOnlyButton(ButtonName=panel_9, ButtonStyle=0)

# ---- group: Instant Throwing Window Style (continued)
adjustpos_70 = AdjustElementPositioning(ElementsToAdjust=pickbtn, Margin="-210,0,0,10", AbsolutePositioning=False, Width=width_16, Height=height_29)
adjustpos_71 = AdjustElementPositioning(ElementsToAdjust=pickbtn_2, Margin="-38,-40,0,10", AbsolutePositioning=False, Width=width_18, Height=height_30)
adjustpos_72 = AdjustElementPositioning(ElementsToAdjust=true_button_3, Margin="170,-40,0,10", AbsolutePositioning=False, Width=width_19, Height=height_31)
merge_17 = Merge(
    Data1=image_7,
    Data2=label_9,
    Data3=tb_7,
    Data4=pickbtn,
    Data5=pickbtn_2,
    Data6=true_button_3,
    Data7=expander_10,
    Data8=checkbox_7,
    Data9=button_21)
addelems_8 = AddElements(Window=launchwin_6, Elements=flatten(merge_17), DoVLChecking=True)  # -> AddedElements, ElementNames

# ----
values_12 = ValueListener(Elements=pickbtn, SomeProperty=True)  # -> Values, Indices
values_13 = ValueListener(Elements=pickbtn_2, SomeProperty=True)  # -> Values, Indices
values_14 = ValueListener(Elements=true_button_3, SomeProperty=True)  # -> Values, Indices
values_15 = ValueListener(Elements=slider_13, SomeProperty=True)  # -> Values, Indices
values_16 = ValueListener(Elements=slider_14, SomeProperty=True)  # -> Values, Indices
values_17 = ValueListener(Elements=checkbox_7, SomeProperty=True)  # -> Values, Indices
setdironly = SetDirectionOnly(Select=values_14.Values)  # -> DirVector, ArrowCrv
msthrow = MS_Throwing(
    Arm=values_12.Values,
    Body=values_13.Values,
    ThrowDirection=setdironly.DirVector,
    Energy=values_15.Values,
    Angle=values_16.Values,
    AddLock=values_17.Values)  # -> Units, Entities
